# Grasshopper definition CaseC.ghx (Grasshopper 1.0.8)
# plug-ins: Pufferfish, Outdoor

Z = UnitZ(Factor="0.1")
panel = Panel("""0.01
0.02
0.03
0.05
0.07
0.1
0.15
0.2
0.25
0.3
0.35
0.4
0.6
0.8
1
1.2""")
panel_2 = Panel("""2.372
2.434
2.548
2.912
3.042
3.392
3.483
3.654
3.82
4.019
4.205
4.343
4.985
5.713
6.12
6.201""")
panel_3 = Panel("""0.470
0.477
0.475
0.725
0.756
0.828
0.913
0.962
0.989
0.927
1.033
0.982
0.950
0.517
0.120
0.033""")
box = CenterBox(Base=PlaneXY(0, 0, 0), X="0.1", Y="0.1", Z="0.1")
series = Series(Start=0, Step="22.5", Count=Slider(3, range=0..100))
dom = ConstructDomain(DomainStart=expr("x*2", "0.1"), DomainEnd=expr("x*-2", "0.1"))
move = Move(Geometry=box, Motion=Z)  # -> Geometry, Transform
panel_4 = Panel(series)
area = Area(Geometry=move.Geometry)  # -> Area, Centroid
inflow = ManualInflowProfile(
    WindDirections=series,
    NormalizedHeightZZR=panel,
    NormalizedVelocityUUR=panel_2,
    NormalizedTKEKUR2=panel_3,
    BoundaryLayerHeightZR=1,
    ReferenceVelocityUR=1,
    Cmu=0.09)  # -> BoundaryConditions, WindVectors
rectangle = Rectangle(Plane=area.Centroid, XSize=dom, YSize=dom, Radius=0)  # -> Rectangle, Length
runsettings = RunSettings(
    Iterations=500,
    WriteInterval=Slider(50, range=0..100),
    KeepTimeSteps=3,
    TurbulenceModel="realizableKE",
    CPUCount="16",
    SolverAlgorithm="SIMPLEC",
    AgeOfAir=False,
    Robustness="4",
    PotentialFoamInit=False,
    LayerAverage=False)  # -> RunSettings, DebugLogs
meshsettings = MeshSettings(
    RefinementBoxLevel=5,
    BuildingSurfaceLevel=5,
    BuildingFeatureLevel=4,
    GroundSurfaceLevel=6,
    LayerCount=4,
    AddLayers=False,
    Snap=True,
    GradingStrengthHorizontal=1,
    GradingStrengthVertical=1,
    AdaptiveGrading=False,
    WakeRefinement=3)
cyldomain = CylinderDomain(
    CoreCellSize=0.5,
    InnerCoreSize=-1,
    OuterRadius=-1,
    Height=-1,
    RadialMultiplier=2,
    CoreDivisions=1,
    RefinementBoxExtension=-1,
    RadialGrading=1,
    CoreRoundness=0.65,
    VerticalGrading=1)
arrrec = RectangularArray(Geometry=move.Geometry, Cell=rectangle.Rectangle, XCount=3, YCount=3)  # -> Geometry, Transform
geo = Geometry(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)
cir = Circle(Plane=PlaneXY(0, 0, 0), Radius=10)
path = FilePath("C:\Eddy3D-Cases\")
srf = Surface(cir)
panel_5 = Panel("""-0.3
-0.3
-0.3
-0.3
-0.3
-0.3
-0.25
-0.25
-0.25
-0.25
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""")
panel_6 = Panel("""-0.25
-0.2
-0.15
0.15
0.2
0.25
-0.3
-0.25
-0.2
-0.15
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""")
move_2 = Move(Geometry=arrrec.Geometry, Motion=Vector(-0.4, -0.4, 0))  # -> Geometry, Transform
windcase = WindCase(
    CaseName="AIJ_CASE_C",
    WorkingDirectory=path,
    BoundaryConditions=inflow.BoundaryConditions,
    DomainParameters=cyldomain,
    Buildings=move_2.Geometry,
    Terrain=srf,
    MeshSettings=meshsettings,
    RunSettings=runsettings.RunSettings,
    WriteCase=Toggle(True),
    ClearCase=False,
    PreviewDimensions=True,
    PreviewGrid3D=False,
    PreviewGroundGrid=True,
    PreviewWindArrows=True)  # -> Logs, WriteLogs, Case, Domain, RefinementBox, Buildings
box_2 = Box(windcase.RefinementBox)
pt = ConstructPoint(XCoordinate=panel_6, YCoordinate=expr("x*-1", panel_5), ZCoordinate="0.02")
scripts = WriteRunScripts(Case=windcase.Case, Parallel=True, Engine="BlueCFD", ProbeName="probes", Write=Toggle(True))  # -> ScriptsFolder, Logs
lng = ListLength(List=pt)
cir_2 = Circle(Plane=pt, Radius=0.01)
series_2 = Series(Start=1, Step=1, Count=lng)
tag = TextTag(Location=pt, Text=series_2, Colour=RGB(0, 0, 0))
probe = Probe(
    Case=windcase.Case,
    Points=pt,
    Fields=["U", "k"],
    ProbeName="probes",
    Run=Toggle(False),
    BakeTimeHistory=False,
    CullHugeVectors=True,
    CullInvalid=True,
    ShowRegion=False)  # -> simplify(Values), TimeSteps, SubResults
branch = TreeBranch(Tree=probe.Values, Path=Toggle(False), MaintainPaths=True)
branch_2 = TreeBranch(Tree=probe.Values, Path=Toggle(True), MaintainPaths=True)
vlen = VectorLength(Vector=branch)
expression = Expression(x=vlen, y=branch_2, Expression="(x²+(2*y))^(1/2)")
roundd = RoundToDecimalPlace(NumberX=expression, DecimalPlace=2, RoundType=0)  # -> Rounded, Difference

# ---- group: Comparison for North direction
cfd = Panel(roundd.Rounded)
north_ground_truth = Panel("""2.91
3
2.35
2.49
2.86
2.68
1.13
2.77
2.69
2.17
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""")
