# Grasshopper definition CaseD.ghx (Grasshopper 1.0.8)
# plug-ins: Pufferfish, Outdoor

panel = Panel("""0.02 
0.04 
0.08 
0.12 
0.20 
0.40 
0.80 
1.20 
1.60 
2.40 
3.20 
4.00 
4.80 """)
panel_2 = Panel("""0.576 
0.620 
0.650 
0.673 
0.713 
0.800 
0.945 
1.050 
1.135 
1.305 
1.432 
1.507 
1.514 """)
panel_3 = Panel("""0.012 
0.014 
0.015 
0.015 
0.017 
0.017 
0.017 
0.016 
0.014 
0.010 
0.006 
0.003 
0.002 """)
series = Series(Start=0, Step="22.5", Count=Slider(16, range=0..100))
panel_4 = Panel(series)
inflow = ManualInflowProfile(
    WindDirections=series,
    NormalizedHeightZZR=panel,
    NormalizedVelocityUUR=panel_2,
    NormalizedTKEKUR2=panel_3,
    BoundaryLayerHeightZR=100,
    ReferenceVelocityUR=6.65,
    Cmu=0.09)  # -> BoundaryConditions, WindVectors
runsettings = RunSettings(
    Iterations=1000,
    WriteInterval=Slider(50, range=0..100),
    KeepTimeSteps=3,
    TurbulenceModel="realizableKE",
    CPUCount="16",
    SolverAlgorithm="SIMPLEC",
    AgeOfAir=False,
    Robustness="4",
    PotentialFoamInit=False)  # -> RunSettings, DebugLogs
meshsettings = MeshSettings(
    RefinementBoxLevel=4,
    BuildingSurfaceLevel=5,
    BuildingFeatureLevel=5,
    GroundSurfaceLevel=3,
    LayerCount=4,
    AddLayers=False,
    Snap=True,
    GradingStrengthHorizontal=1,
    GradingStrengthVertical=1,
    AdaptiveGrading=False,
    WakeRefinement=3)
cyldomain = CylinderDomain(
    CoreCellSize="50",
    InnerCoreSize=-1,
    OuterRadius=1000,
    Height="480",
    RadialMultiplier=2,
    CoreDivisions=1,
    RefinementBoxExtension=-1,
    RadialGrading=1,
    CoreRoundness=0.65,
    VerticalGrading=1)
geo = Geometry(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)

# ---- group: Terrain
geo_2 = Geometry(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)

# ----
path = FilePath("C:\Eddy3D-Cases\")
panel_5 = Panel("""-137.5
-137.5
-112.5
-112.5
-87.5
-87.5
-87.5
-87.5
-87.5
-87.5
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""")
panel_6 = Panel("""62.5
-62.5
62.5
-62.5
112.5
87.5
62.5
37.5
12.5
-12.5
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""")
windcase = WindCase(
    CaseName="AIJ_CASE_D",
    WorkingDirectory=path,
    BoundaryConditions=inflow.BoundaryConditions,
    DomainParameters=cyldomain,
    Buildings=geo,
    Terrain=geo_2,
    MeshSettings=meshsettings,
    RunSettings=runsettings.RunSettings,
    WriteCase=Toggle(True),
    ClearCase=False,
    PreviewDimensions=True,
    PreviewGrid3D=False,
    PreviewGroundGrid=True,
    PreviewWindArrows=True)  # -> Logs, WriteLogs, Case, Domain, RefinementBox, Buildings
division = Division(A=panel_6, B=2.5)
division_2 = Division(A=panel_5, B=2.5)
box = Box(windcase.RefinementBox)
pt = ConstructPoint(XCoordinate=division_2, YCoordinate=division, ZCoordinate="2")
scripts = WriteRunScripts(Case=windcase.Case, Parallel=True, Engine="BlueCFD", ProbeName="probes", Write=Toggle(True))  # -> ScriptsFolder, Logs
lng = ListLength(List=pt)
cir = Circle(Plane=pt, Radius=3)
series_2 = Series(Start=1, Step=1, Count=lng)
tag = TextTag(Location=pt, Text=series_2, Colour=RGB(0, 0, 0))
probe = Probe(
    Case=windcase.Case,
    Points=pt,
    Fields="U",
    ProbeName="probes",
    Run=Toggle(False),
    BakeTimeHistory=False,
    CullHugeVectors=True,
    CullInvalid=True,
    ShowRegion=False)  # -> Values, TimeSteps, SubResults
toggle = BooleanToggle(False)
vlen = VectorLength(Vector=probe.Values)
roundd = RoundToDecimalPlace(NumberX=vlen, DecimalPlace=2, RoundType=0)  # -> Rounded, Difference

# ---- group: Comparison for North direction
cfd = Panel(roundd.Rounded)
north_ground_truth = Panel("""1.296
1.296
1.307
1.307
2.341
2.459
2.38
3.022
3.027
3.027
3.022
2.38
2.459
2.341
1.982
2.099
2.271
2.025
1.608
1.608
2.025
2.271
2.099
1.982
3.271
-
-
-
-
3.271
4.391
-
-
4.391
4.89
-
-
4.89
4.585
-
-
-
-
4.585
1.134
0.928
4.169
4.159
3.155
3.155
4.159
4.169
0.928
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""")
